# Grasshopper definition parametric chair.gh (Grasshopper 1.0.8)

# ---- group: Seat params
seat_height = Slider(26.19, range=0..50)
seat_depth = Slider(2.185, range=0..10)
number_slider = Slider(17, range=0..100)
number_slider_2 = Slider(10, range=0..10)
number_slider_3 = Slider(20, range=1..20)
pt = ConstructPoint(XCoordinate=0, YCoordinate=0, ZCoordinate=seat_height)
addition = Addition(A=seat_height, B=seat_depth)
pt_2 = ConstructPoint(XCoordinate=0, YCoordinate=0, ZCoordinate=addition)
polygon = Polygon(Plane=pt_2, Radius=number_slider, Segments=number_slider_3, FilletRadius=number_slider_2)  # -> Polygon, Length
polygon_2 = Polygon(Plane=pt, Radius=number_slider, Segments=number_slider_3, FilletRadius=number_slider_2)  # -> Polygon, Length
merge = Merge(Data1=polygon.Polygon, Data2=polygon_2.Polygon)

# ---- group: Leg params
number_of_legs = Slider(3, range=1..10)
leg_radius = Slider(14.4, range=0..20)
division = Division(A=1, B=number_of_legs)
series = Series(Start=0, Step=division, Count=number_of_legs)
pi = Pi(Factor=2)
multiplication = Multiplication(A=pi, B=series)
sin = Sine(Value=multiplication)
cos = Cosine(Value=multiplication)
multiplication_2 = Multiplication(A=cos, B=leg_radius)
multiplication_3 = Multiplication(A=sin, B=leg_radius)
pt_3 = ConstructPoint(XCoordinate=multiplication_2, YCoordinate=multiplication_3, ZCoordinate=0)
top_leg_flare = Slider(0.776, range=0..1)
polar = ToPolar(Point=pt_3, System=PlaneXY(0, 0, 0))  # -> Phi, Theta, Radius
multiplication_4 = Multiplication(A=polar.Radius, B=top_leg_flare)
pt_4 = PointPolar(BasePlane=PlaneXY(0, 0, 0), XYAngle=polar.Phi, ZAngle=0, Offset=multiplication_4)
number_slider_4 = Slider(10, range=3..10)
pdecon = Deconstruct(Point=pt_4)  # -> XComponent, YComponent, ZComponent
pt_5 = ConstructPoint(XCoordinate=pdecon.XComponent, YCoordinate=pdecon.YComponent, ZCoordinate=seat_height)
polygon_3 = Polygon(Plane=pt_5, Radius=3, Segments=number_slider_4, FilletRadius=0)  # -> graft(Polygon), Length
polygon_4 = Polygon(Plane=pt_3, Radius=3, Segments=number_slider_4, FilletRadius=0)  # -> graft(Polygon), Length
merge_2 = Merge(Data1=polygon_3.Polygon, Data2=polygon_4.Polygon)

# ---- group: Back params
back_bottom_wideness = Slider(12.54, range=10..100.001)
back_top_wideness = Slider(38.302, range=0..50)
height = Slider(46.52, range=0..100)
neg = Negative(Value=back_bottom_wideness)
merge_3 = Merge(Data1=back_bottom_wideness, Data2=neg)
avr = Average(Input=merge_3)
addition_2 = Addition(A=avr, B=back_top_wideness)
pt_6 = ConstructPoint(XCoordinate=back_bottom_wideness, YCoordinate=0, ZCoordinate=0)
pt_7 = ConstructPoint(XCoordinate=neg, YCoordinate=0, ZCoordinate=0)
neg_2 = Negative(Value=addition_2)
pt_8 = ConstructPoint(XCoordinate=addition_2, YCoordinate=0, ZCoordinate=height)
pt_9 = ConstructPoint(XCoordinate=neg_2, YCoordinate=0, ZCoordinate=height)
merge_4 = Merge(Data1=pt_6, Data2=pt_8, Data3=pt_9, Data4=pt_7)
back_extrusion_depth = Slider(2.167, range=0..100)
nurbs = NurbsCurve(Vertices=merge_4, Degree=3, Periodic=False)  # -> Curve, Length, Domain
ln = Line(StartPoint=pt_6, EndPoint=pt_7)
merge_5 = Merge(Data1=nurbs.Curve, Data2=ln)
Y = UnitY(Factor=back_extrusion_depth)
move = Move(Geometry=merge_5, Motion=Y)  # -> Geometry, Transform
boundary = BoundarySurfaces(Edges=move.Geometry)
boundary_2 = BoundarySurfaces(Edges=merge_5)
merge_6 = Merge(Data1=boundary_2, Data2=boundary)
loft = Loft(Curves=merge_6, Options={Adjust=False, Closed=False, LoftEnds=0, LoftSimp=0, LoftType=0, Rebuild=10, Refit=0.01})
merge_7 = Merge(Data1=loft, Data2=merge_6)
neg_3 = Negative(Value=Slider(8.641, range=1..100))
rotate = Rotate(Geometry=merge_7, Angle=1.570796327, Plane=PlaneXY(0, 0, 0))  # -> Geometry, Transform
X = UnitX(Factor=neg_3)
move_2 = Move(Geometry=rotate.Geometry, Motion=pt)  # -> Geometry, Transform

# ---- group: Final Legs
loft_2 = Loft(Curves=merge_2, Options={Adjust=False, Closed=False, LoftEnds=0, LoftSimp=0, LoftType=0, Rebuild=10, Refit=0.01})
cap = CapHoles(Brep=loft_2)  # -> flatten(Brep)

# ---- group: Final Back
move_3 = Move(Geometry=move_2.Geometry, Motion=X)  # -> Geometry, Transform

# ---- group: Final Seat
loft_3 = Loft(Curves=merge, Options={Adjust=False, Closed=False, LoftEnds=0, LoftSimp=0, LoftType=0, Rebuild=10, Refit=0.01})
cap_2 = CapHoles(Brep=loft_3)

# ----
merge_8 = Merge(Data1=cap, Data2=cap_2, Data3=move_3.Geometry)
brep = Brep(merge_8)
